# Dynamo graph Beam.dyn (Dynamo 2.0.2.6826)

# group: Start Axis model
startAxModel = DyToAxisVM.AxModel.StartAxModel()

# group: Create a line
byCoordinates = Point.ByCoordinates()
number_slider_span_of_beam = DoubleSlider(27.1, range=0..100 step 0.1)
byCoordinates_2 = Point.ByCoordinates(x=number_slider_span_of_beam)
byStartPointEndPoint = Line.ByStartPointEndPoint(startPoint=byCoordinates, endPoint=byCoordinates_2)

# group: Export lines
boolean = BoolSelector(false)
sendLines = DyToAxisVM.ExportOptions.SendLines(AxModel=startAxModel, b=boolean, ln=byStartPointEndPoint)

# group: ------------------------------------------------- To start the export: (1) Start a new AxModel with the StartAxModel node (2) connect the AxModel and a Boolean input node to the AxisVM Export nodes (SendLines or SendMembers) and set it to True. An AxisVM window will soon open with the exported model in it. In case of larger models, this may take several seconds. -------------------------------------------------
boolean_2 = BoolSelector(false)
startAxModel_2 = DyToAxisVM.AxModel.StartAxModel()

# group: Create structural member: AxMember
string = StringInput("S 235")
string_2 = StringInput("IPE 240")
string_3 = StringInput("beam")
byProperties = DyToAxisVM.AxMember.ByProperties(line=byStartPointEndPoint, material=string, crossSection=string_2, type=string_3)

# group: Export structural elements
boolean_3 = BoolSelector(false)
sendMembers = DyToAxisVM.ExportOptions.SendMembers(AxModel=startAxModel, b=boolean_3, axm=byProperties)

# group: Add load
selfWeight = DyToAxisVM.Load.SelfWeight(AxModel=sendMembers.AxModel)

# group: _____________________________________ Add supports For ptID, create a list of integers with the supported node IDs. -NOTE: AxisVM node IDs start with 1, not zero! PtListIndex node helps in creating the list of integers: it finds the node IDs of the supported nodes (pt) in the list of nodes of the AxModel (pts) _____________________________________
ptListIndex = DyToAxisVM.Extra.PtListIndex(pts=sendMembers.Points, pt=sendMembers.Points)
pinnedNodalSupport = DyToAxisVM.Support.PinnedNodalSupport(AxModel=sendMembers.AxModel, ptID=ptListIndex)

# group: _________________________________ Run linear static analysis (WIP - Work in Progress) If this is turned on, the analysis will rerun after updating the model. Updating may be: changing geometric parameters, structural member properties, adding load and supports. NOTE: If changing the topology (e.g., number of beams), start a new AxModel. _________________________________
boolean_4 = BoolSelector(false)
linearAnalysis = DyToAxisVM.Analysis.LinearAnalysis(AxModel=pinnedNodalSupport.AxModel, b=boolean_4)
