# Dynamo graph Corrugated Vault.dyn "Vault v2" (Dynamo 2.0.1.5055)

# group: Start an AxisVM modell
startAxModel = DyToAxisVM.AxModel.StartAxModel()

# group: Parameters
length = DoubleSlider(43.1, range=0..50 step 0.1)
boundary_waves = DoubleSlider(5, range=0..5 step 1)
entrance_span = DoubleSlider(26.2, range=0..50 step 0.1)
span_range = DoubleSlider(2, range=0..10 step 1)
entrance_height = DoubleSlider(8, range=0..50 step 0.1)
density_along_length = IntegerSlider(39, range=1..50 step 2)
section_shape = IntegerSlider(0, range=0..1 step 1)
density_along_section = IntegerSlider(17, range=0..50 step 1)

# group: Create geometry
origin = Point.Origin()
YAxis = Vector.YAxis()
byStartPointDirectionLength = Line.ByStartPointDirectionLength(startPoint=origin, direction=YAxis, length=length)
code_block = CodeBlock(x=boundary_waves) { Math.Abs(1/(4*x-2)); Math.Max(x*4-1,3); }
sequence = Sequence(amount=code_block.out1, step=code_block.out0)
pointAtParameter = Curve.PointAtParameter(curve=byStartPointDirectionLength, param=sequence)
code_block_2 = CodeBlock(x=boundary_waves) { Math.Min(4*x*90-180,0); 90; Math.Max(1,4*x-1); }
sequence_2 = Sequence(amount=code_block_2.out2, step=code_block_2.out1)
sin = Math.Sin(angle=sequence_2)
code_block_3 = CodeBlock(x=entrance_span, y=sin, z=span_range, h=entrance_height) { x/2+y*z/4; -x/2-y*z/4; h+y*z/4; }
translate = Geometry.Translate(geometry=pointAtParameter, xTranslation=code_block_3.out0, lacing=Longest)
byPoints = NurbsCurve.ByPoints(points=translate)
code_block_4 = CodeBlock(x=density_along_length) { 1/(x-1); }
sequence_3 = Sequence(amount=density_along_length, step=code_block_4)
pointAtParameter_2 = Curve.PointAtParameter(curve=byPoints, param=sequence_3)
translate_2 = Geometry.Translate(geometry=pointAtParameter, zTranslation=code_block_3.out2, lacing=Longest)
byPoints_2 = NurbsCurve.ByPoints(points=translate_2)
pointAtParameter_3 = Curve.PointAtParameter(curve=byPoints_2, param=sequence_3)
translate_3 = Geometry.Translate(geometry=pointAtParameter, xTranslation=code_block_3.out1, lacing=Longest)
byPoints_3 = NurbsCurve.ByPoints(points=translate_3)
pointAtParameter_4 = Curve.PointAtParameter(curve=byPoints_3, param=sequence_3)
byThreePoints = Arc.ByThreePoints(firstPoint=pointAtParameter_2, secondPoint=pointAtParameter_3, thirdPoint=pointAtParameter_4)
list_create = List.Create(item0=pointAtParameter_2, item1=pointAtParameter_3, item2=pointAtParameter_4)
transpose = List.Transpose(lists=list_create)
byPoints_4 = NurbsCurve.ByPoints(points=transpose)
list_create_2 = List.Create(item0=byThreePoints, item1=byPoints_4)
getItemAtIndex = List.GetItemAtIndex(list=list_create_2, index=section_shape)
code_block_5 = CodeBlock(x=density_along_section) { 1/(x-1); 1/(x-1)/2; x*2-1; }
sequence_4 = Sequence(amount=density_along_section, step=code_block_5.out0)
pointAtParameter_5 = Curve.PointAtParameter(curve=getItemAtIndex, param=sequence_4, lacing=CrossProduct)
number = DoubleInput(2)
dropEveryNthItem = List.DropEveryNthItem(list=pointAtParameter_5, n=number)
sequence_5 = Sequence(amount=code_block_5.out2, step=code_block_5.out1)
number_2 = DoubleInput(1)
dropEveryNthItem_2 = List.DropEveryNthItem(list=sequence_5, n=number, offset=number_2)
pointAtParameter_6 = Curve.PointAtParameter(curve=getItemAtIndex, param=dropEveryNthItem_2, lacing=CrossProduct)
dropEveryNthItem_3 = List.DropEveryNthItem(list=pointAtParameter_6, n=number, offset=number_2)
byStartPointEndPoint = Line.ByStartPointEndPoint(startPoint=dropEveryNthItem, endPoint=dropEveryNthItem_3, lacing=Shortest)
reverse = List.Reverse(list=dropEveryNthItem, lacing=Longest)
reverse_2 = List.Reverse(list=dropEveryNthItem_3, lacing=Longest)
byStartPointEndPoint_2 = Line.ByStartPointEndPoint(startPoint=reverse, endPoint=reverse_2, lacing=Shortest)
transpose_2 = List.Transpose(lists=reverse)
reverse_3 = List.Reverse(list=transpose_2, lacing=Longest)
transpose_3 = List.Transpose(lists=reverse_2)
reverse_4 = List.Reverse(list=transpose_3, lacing=Longest)
byStartPointEndPoint_3 = Line.ByStartPointEndPoint(startPoint=reverse_3, endPoint=reverse_4, lacing=Shortest)
transpose_4 = List.Transpose(lists=dropEveryNthItem)
reverse_5 = List.Reverse(list=transpose_4, lacing=Longest)
transpose_5 = List.Transpose(lists=dropEveryNthItem_3)
reverse_6 = List.Reverse(list=transpose_5, lacing=Longest)
byStartPointEndPoint_4 = Line.ByStartPointEndPoint(startPoint=reverse_5, endPoint=reverse_6, lacing=Shortest)
join = List.Join(list0=byStartPointEndPoint, list1=byStartPointEndPoint_2, list2=byStartPointEndPoint_3, list3=byStartPointEndPoint_4)
number_3 = DoubleInput(1)
dropItems = List.DropItems(list=transpose_4, amount=number_3)
byStartPointEndPoint_5 = Line.ByStartPointEndPoint(startPoint=transpose_4, endPoint=dropItems, lacing=Shortest)
dropItems_2 = List.DropItems(list=transpose_5, amount=number_3)
byStartPointEndPoint_6 = Line.ByStartPointEndPoint(startPoint=transpose_5, endPoint=dropItems_2, lacing=Shortest)
transpose_6 = List.Transpose(lists=pointAtParameter_5)
number_4 = DoubleInput(1)
takeItems = List.TakeItems(list=transpose_6, amount=number_4)
transpose_7 = List.Transpose(lists=takeItems)
number_5 = DoubleInput(2)
dropEveryNthItem_4 = List.DropEveryNthItem(list=transpose_7, n=number_5, offset=number_4)
transpose_8 = List.Transpose(lists=pointAtParameter_6)
takeItems_2 = List.TakeItems(list=transpose_8, amount=number_4)
transpose_9 = List.Transpose(lists=takeItems_2)
dropEveryNthItem_5 = List.DropEveryNthItem(list=transpose_9, n=number_5, offset=number_4)
byStartPointEndPoint_7 = Line.ByStartPointEndPoint(startPoint=dropEveryNthItem_4, endPoint=dropEveryNthItem_5, lacing=Shortest)
transpose_10 = List.Transpose(lists=pointAtParameter_5)
number_6 = DoubleInput(-1)
takeItems_3 = List.TakeItems(list=transpose_10, amount=number_6)
transpose_11 = List.Transpose(lists=takeItems_3)
dropEveryNthItem_6 = List.DropEveryNthItem(list=transpose_11, n=number_5, offset=number_4)
transpose_12 = List.Transpose(lists=pointAtParameter_6)
takeItems_4 = List.TakeItems(list=transpose_12, amount=number_6)
transpose_13 = List.Transpose(lists=takeItems_4)
dropEveryNthItem_7 = List.DropEveryNthItem(list=transpose_13, n=number_5, offset=number_4)
byStartPointEndPoint_8 = Line.ByStartPointEndPoint(startPoint=dropEveryNthItem_6, endPoint=dropEveryNthItem_7, lacing=Shortest)
join_2 = List.Join(list0=byStartPointEndPoint_5, list1=byStartPointEndPoint_6, list2=byStartPointEndPoint_7, list3=byStartPointEndPoint_8)
dropItems_3 = List.DropItems(list=pointAtParameter_2, amount=number_3)
byStartPointEndPoint_9 = Line.ByStartPointEndPoint(startPoint=pointAtParameter_2, endPoint=dropItems_3, lacing=Shortest)
dropItems_4 = List.DropItems(list=pointAtParameter_4, amount=number_3)
byStartPointEndPoint_10 = Line.ByStartPointEndPoint(startPoint=pointAtParameter_4, endPoint=dropItems_4, lacing=Shortest)
join_3 = List.Join(list0=byStartPointEndPoint_9, list1=byStartPointEndPoint_10)

flatten = List.Flatten(list=join)
flatten_2 = List.Flatten(list=join_2)
flatten_3 = List.Flatten(list=join_3)

# group: AxMembers
string = StringInput("ROR  133,00*   7,1")
byProperties = DyToAxisVM.AxMember.ByProperties(line=flatten, crossSection=string)
string_2 = StringInput("ROR  273,00*  10,0")
byProperties_2 = DyToAxisVM.AxMember.ByProperties(line=flatten_2, crossSection=string_2)
string_3 = StringInput("ROR  133,00*   7,1")
byProperties_3 = DyToAxisVM.AxMember.ByProperties(line=flatten_3, crossSection=string_3)

join_4 = List.Join(list0=byProperties, list1=byProperties_2, list2=byProperties_3)
flatten_4 = List.Flatten(list=join_4)

# group: Export members
boolean = BoolSelector(false)
sendMembers = DyToAxisVM.ExportOptions.SendMembers(AxModel=startAxModel, b=boolean, axm=flatten_4)

# group: Analysis
boolean_2 = BoolSelector(false)
linearAnalysis = DyToAxisVM.Analysis.LinearAnalysis(AxModel=sendMembers.AxModel, b=boolean_2)

ptListIndex = DyToAxisVM.Extra.PtListIndex(pts=sendMembers.Points, pt=sendMembers.Points)

# group: Add load
selfWeight = DyToAxisVM.Load.SelfWeight(AxModel=sendMembers.AxModel)
string_4 = StringInput("ST1")
number_7 = DoubleInput(-5)
pointLoad = DyToAxisVM.Load.PointLoad(AxModel=selfWeight, ptID=ptListIndex, lcName=string_4, Fz=number_7)

firstItem = List.FirstItem(list=pointAtParameter_2)
firstItem_2 = List.FirstItem(list=pointAtParameter_4)
join_5 = List.Join(list0=firstItem, list1=firstItem_2)

# group: Add supports
ptListIndex_2 = DyToAxisVM.Extra.PtListIndex(pts=sendMembers.Points, pt=join_5)
number_8 = DoubleInput(0)
nodalSupport = DyToAxisVM.Support.NodalSupport(AxModel=sendMembers.AxModel, ptID=ptListIndex_2, Rxx=number_8, Ryy=number_8, Rzz=number_8)
number_9 = DoubleInput(0)
ptListIndexAtHeight = DyToAxisVM.Extra.PtListIndexAtHeight(pts=sendMembers.Points, Z=number_9)
nodalSupport_2 = DyToAxisVM.Support.NodalSupport(AxModel=nodalSupport.AxModel, ptID=ptListIndexAtHeight, Ry=number_8, Rxx=number_9, Ryy=number_9, Rzz=number_9)
code_block_6 = CodeBlock(x=ptListIndex_2) { x-1; }
