# Dynamo graph FrameTemplate.dyn (Dynamo 2.0.1.5055)

startAxModel = DyToAxisVM.AxModel.StartAxModel()

# group: Parameters
number_of_bays_x = IntegerSlider(5, range=0..100 step 1)
span_x_x = DoubleSlider(11, range=0..30 step 0.1)
number_of_bays_y = IntegerSlider(3, range=0..100 step 1)
span_y_m = DoubleSlider(7, range=0..30 step 0.1)
height_of_first_floor_m = DoubleSlider(5, range=0..20 step 0.1)
number_of_floors = IntegerSlider(5, range=0..100 step 1)
height_of_rest_of_the_floors_m = DoubleSlider(3.3, range=0..20 step 0.1)

# group: Create geometry
code_block = CodeBlock(x=number_of_bays_x) { x+1; }
sequence = Sequence(amount=code_block, step=span_x_x)
code_block_2 = CodeBlock(x=number_of_bays_y) { x+1; }
sequence_2 = Sequence(amount=code_block_2, step=span_y_m)
code_block_3 = CodeBlock { 0; }
code_block_4 = CodeBlock(x=number_of_floors) { x-1; }
sequence_3 = Sequence(start=height_of_first_floor_m, amount=code_block_4, step=height_of_rest_of_the_floors_m)
join = List.Join(list0=code_block_3, list1=sequence_3)
byCoordinates = Point.ByCoordinates(x=sequence, y=sequence_2, z=join, lacing=CrossProduct)
byPoints = PolyCurve.ByPoints(points=byCoordinates, lacing=CrossProduct)
flatten = List.Flatten(list=byPoints)
curves = PolyCurve.Curves(polyCurve=flatten)
byCoordinates_2 = Point.ByCoordinates(x=sequence@L2, y=sequence_2, z=sequence_3, lacing=CrossProduct)
byPoints_2 = PolyCurve.ByPoints(points=byCoordinates_2)
flatten_2 = List.Flatten(list=byPoints_2)
curves_2 = PolyCurve.Curves(polyCurve=flatten_2)
byCoordinates_3 = Point.ByCoordinates(x=sequence, y=sequence_2@L2, z=sequence_3, lacing=CrossProduct)
byPoints_3 = PolyCurve.ByPoints(points=byCoordinates_3)
flatten_3 = List.Flatten(list=byPoints_3)
curves_3 = PolyCurve.Curves(polyCurve=flatten_3)

# group: Split columns into lists
transpose = List.Transpose(lists=curves)
firstItem = List.FirstItem(list=transpose)
restOfItems = List.RestOfItems(list=transpose)
firstItem_2 = List.FirstItem(list=restOfItems)
restOfItems_2 = List.RestOfItems(list=restOfItems)

# group: Curves to Lines
first_level_columns = List.Create(item0=firstItem)
startPoint = Curve.StartPoint(curve=first_level_columns)
endPoint = Curve.EndPoint(curve=first_level_columns)
byStartPointEndPoint = Line.ByStartPointEndPoint(startPoint=startPoint, endPoint=endPoint)
second_level_columns = List.Create(item0=firstItem_2)
startPoint_2 = Curve.StartPoint(curve=second_level_columns)
endPoint_2 = Curve.EndPoint(curve=second_level_columns)
byStartPointEndPoint_2 = Line.ByStartPointEndPoint(startPoint=startPoint_2, endPoint=endPoint_2)
rest_of_the = List.Create(item0=restOfItems_2)
startPoint_3 = Curve.StartPoint(curve=rest_of_the)
endPoint_3 = Curve.EndPoint(curve=rest_of_the)
byStartPointEndPoint_3 = Line.ByStartPointEndPoint(startPoint=startPoint_3, endPoint=endPoint_3)
beam_x = List.Create(item0=curves_2)
startPoint_4 = Curve.StartPoint(curve=beam_x)
endPoint_4 = Curve.EndPoint(curve=beam_x)
byStartPointEndPoint_4 = Line.ByStartPointEndPoint(startPoint=startPoint_4, endPoint=endPoint_4)
beam_y = List.Create(item0=curves_3)
startPoint_5 = Curve.StartPoint(curve=beam_y)
endPoint_5 = Curve.EndPoint(curve=beam_y)
byStartPointEndPoint_5 = Line.ByStartPointEndPoint(startPoint=startPoint_5, endPoint=endPoint_5)

# group: Create AxMembers with various cross-section sizes
string = StringInput("S 235")
string_2 = StringInput("HE  260 M")
string_3 = StringInput("beam")
byProperties = DyToAxisVM.AxMember.ByProperties(line=byStartPointEndPoint, material=string, crossSection=string_2, type=string_3)
string_4 = StringInput("HE  240 A")
byProperties_2 = DyToAxisVM.AxMember.ByProperties(line=byStartPointEndPoint_2, material=string, crossSection=string_4, type=string_3)
string_5 = StringInput("HE  200 A")
byProperties_3 = DyToAxisVM.AxMember.ByProperties(line=byStartPointEndPoint_3, material=string, crossSection=string_5, type=string_3)
string_6 = StringInput("IPE 240")
byProperties_4 = DyToAxisVM.AxMember.ByProperties(line=byStartPointEndPoint_4, material=string, crossSection=string_6, type=string_3)
string_7 = StringInput("IPE 200")
byProperties_5 = DyToAxisVM.AxMember.ByProperties(line=byStartPointEndPoint_5, material=string, crossSection=string_7, type=string_3)

join_2 = List.Join(list0=byProperties, list1=byProperties_2, list2=byProperties_3, list3=byProperties_4, list4=byProperties_5)
flatten_4 = List.Flatten(list=join_2)

# group: Send AxMembers to Axis
boolean = BoolSelector(false)
sendMembers = DyToAxisVM.ExportOptions.SendMembers(AxModel=startAxModel, b=boolean, axm=flatten_4)

# group: Add supports
ptListIndexAtHeight = DyToAxisVM.Extra.PtListIndexAtHeight(pts=sendMembers.Points)
pinnedNodalSupport = DyToAxisVM.Support.PinnedNodalSupport(AxModel=sendMembers.AxModel, ptID=ptListIndexAtHeight)

# group: Add load
code_block_5 = CodeBlock(h1=height_of_first_floor_m, n=number_of_floors, h2=height_of_rest_of_the_floors_m) { h1+(n-2)*h2; }
ptListIndexAtHeight_2 = DyToAxisVM.Extra.PtListIndexAtHeight(pts=sendMembers.Points, Z=code_block_5)
string_8 = StringInput("ST2")
number = DoubleInput(-5)
pointLoad = DyToAxisVM.Load.PointLoad(AxModel=sendMembers.AxModel, ptID=ptListIndexAtHeight_2, lcName=string_8, Fz=number)
selfWeight = DyToAxisVM.Load.SelfWeight(AxModel=sendMembers.AxModel)
