# Dynamo graph Frame_one_storey.dyn "Frame v2" (Dynamo 2.0.1.5055)

# group: Parameters
column_height = DoubleSlider(4, range=0..10 step 0.1)
span = DoubleSlider(17, range=0..50 step 0.1)
number_of_bays = IntegerSlider(7, range=0..15 step 1)
bay_width = DoubleSlider(5.4, range=0..10 step 0.1)
apex_height = DoubleSlider(1.6, range=0..5 step 0.1)

# group: Create geometry
byCoordinates = Point.ByCoordinates()
byCoordinates_2 = Point.ByCoordinates(z=column_height)
byStartPointEndPoint = Line.ByStartPointEndPoint(startPoint=byCoordinates, endPoint=byCoordinates_2)
byCoordinates_3 = Point.ByCoordinates(x=span, z=column_height)
byCoordinates_4 = Point.ByCoordinates(x=span)
byStartPointEndPoint_2 = Line.ByStartPointEndPoint(startPoint=byCoordinates_3, endPoint=byCoordinates_4)
join = List.Join(list0=byStartPointEndPoint, list1=byStartPointEndPoint_2)
YAxis = Vector.YAxis()
sequence = Sequence(amount=number_of_bays, step=bay_width)
columns = Geometry.Translate(geometry=join, direction=YAxis, distance=sequence, lacing=CrossProduct)
code_block = CodeBlock(x=span) { x/2; }
code_block_2 = CodeBlock(x=apex_height, y=column_height) { x+y; }
byCoordinates_5 = Point.ByCoordinates(x=code_block, z=code_block_2)
byStartPointEndPoint_3 = Line.ByStartPointEndPoint(startPoint=byCoordinates_2, endPoint=byCoordinates_5)
byStartPointEndPoint_4 = Line.ByStartPointEndPoint(startPoint=byCoordinates_5, endPoint=byCoordinates_3)
join_2 = List.Join(list0=byStartPointEndPoint_3, list1=byStartPointEndPoint_4)
beams = Geometry.Translate(geometry=join_2, direction=YAxis, distance=sequence, lacing=CrossProduct)
join_3 = List.Join(list0=byCoordinates_2, list1=byCoordinates_5, list2=byCoordinates_3)
YAxis_2 = Vector.YAxis()
translate = Geometry.Translate(geometry=join_3, direction=YAxis_2, distance=bay_width, lacing=CrossProduct)
byStartPointEndPoint_5 = Line.ByStartPointEndPoint(startPoint=join_3, endPoint=translate)
code_block_3 = CodeBlock(x=number_of_bays) { x-1; }
sequence_2 = Sequence(amount=code_block_3, step=bay_width)
braces = Geometry.Translate(geometry=byStartPointEndPoint_5, direction=YAxis, distance=sequence_2, lacing=CrossProduct)

# group: Flatten lists
flatten = List.Flatten(list=columns)
flatten_2 = List.Flatten(list=beams)
flatten_3 = List.Flatten(list=braces)

# group: Export lines
startAxModel = DyToAxisVM.AxModel.StartAxModel()
boolean = BoolSelector(false)
join_4 = List.Join(list0=flatten, list1=flatten_2, list2=flatten_3)
flatten_4 = List.Flatten(list=join_4)
sendLines = DyToAxisVM.ExportOptions.SendLines(AxModel=startAxModel, b=boolean, ln=flatten_4)

# group: Start AxisVM Model
startAxModel_2 = DyToAxisVM.AxModel.StartAxModel()

# group: Create AxMembers
string = StringInput("HE  200 A")
byProperties = DyToAxisVM.AxMember.ByProperties(line=flatten, crossSection=string)
string_2 = StringInput("HE  160 A")
byProperties_2 = DyToAxisVM.AxMember.ByProperties(line=flatten_2, crossSection=string_2)
string_3 = StringInput("60x60x4")
string_4 = StringInput("truss")
byProperties_3 = DyToAxisVM.AxMember.ByProperties(line=flatten_3, crossSection=string_3, type=string_4)
join_5 = List.Join(list0=byProperties, list1=byProperties_2, list2=byProperties_3)
flatten_5 = List.Flatten(list=join_5)

# group: Export members
boolean_2 = BoolSelector(false)
sendMembers = DyToAxisVM.ExportOptions.SendMembers(AxModel=startAxModel_2, b=boolean_2, axm=flatten_5)

# group: Add load
ptListIndexAtHeight = DyToAxisVM.Extra.PtListIndexAtHeight(pts=sendMembers.Points, Z=code_block_2)
string_5 = StringInput("ST1")
number = DoubleInput(-5)
pointLoad = DyToAxisVM.Load.PointLoad(AxModel=sendMembers.AxModel, ptID=ptListIndexAtHeight, lcName=string_5, Fz=number)

# group: Analysis
boolean_3 = BoolSelector(false)
linearAnalysis = DyToAxisVM.Analysis.LinearAnalysis(AxModel=pointLoad.AxModel, b=boolean_3)

# group: Add supports
number_2 = DoubleInput(0)
ptListIndexAtHeight_2 = DyToAxisVM.Extra.PtListIndexAtHeight(pts=sendMembers.Points, Z=number_2)
fixedNodalSupport = DyToAxisVM.Support.FixedNodalSupport(AxModel=sendMembers.AxModel, ptID=ptListIndexAtHeight_2)
