# Dynamo graph Gridshell.dyn (Dynamo 2.0.2.6826)

startAxModel = DyToAxisVM.AxModel.StartAxModel()

# group: Parameters
span = DoubleSlider(9.4, range=0..12 step 0.1)  # graph input
grid_density = IntegerSlider(14, range=0..100 step 1)
height = DoubleSlider(2.3, range=0..10 step 0.1)  # graph input

# group: Create gridshell geometry
code_block = CodeBlock(x=span) { -x/2; }
code_block_2 = CodeBlock(x=span, y=grid_density) { x/(y-1); }
sequence = Sequence(start=code_block, amount=grid_density, step=code_block_2, lacing=Longest)
sequence_2 = Sequence(start=code_block, amount=grid_density, step=code_block_2, lacing=Longest)
byCoordinates = Point.ByCoordinates(x=sequence, y=sequence_2, lacing=CrossProduct)
X = Point.X(point=byCoordinates)
Y = Point.Y(point=byCoordinates)
code_block_3 = CodeBlock(z=height, x=X, L=span, y=Y) { z*(1-(x*x/(L*L/4)))*(1-(y*y/(L*L/4))); }
translate = Geometry.Translate(geometry=byCoordinates, zTranslation=code_block_3)
reverse = List.Reverse(list=translate)
dropEveryNthItem = List.DropEveryNthItem(list=reverse, n=grid_density)
reverse_2 = List.Reverse(list=dropEveryNthItem)
dropEveryNthItem_2 = List.DropEveryNthItem(list=translate, n=grid_density)
byStartPointEndPoint = Line.ByStartPointEndPoint(startPoint=reverse_2, endPoint=dropEveryNthItem_2)
transpose = List.Transpose(lists=translate)
reverse_3 = List.Reverse(list=transpose)
dropEveryNthItem_3 = List.DropEveryNthItem(list=reverse_3, n=grid_density)
reverse_4 = List.Reverse(list=dropEveryNthItem_3)
dropEveryNthItem_4 = List.DropEveryNthItem(list=transpose, n=grid_density)
byStartPointEndPoint_2 = Line.ByStartPointEndPoint(startPoint=reverse_4, endPoint=dropEveryNthItem_4)
join = List.Join(list0=byStartPointEndPoint, list1=byStartPointEndPoint_2)

# group: ---IMPORTANT!--- Flatten the list of lines before using the AxisVM export nodes - otherwise multiple AxisVM models are created
flatten = List.Flatten(list=join)

# group: Export structural members
boolean = BoolSelector(false)  # graph input
string = StringInput("S 235")
string_2 = StringInput("IPE 240")
string_3 = StringInput("beam")
byProperties = DyToAxisVM.AxMember.ByProperties(line=flatten, material=string, crossSection=string_2, type=string_3)
sendMembers = DyToAxisVM.ExportOptions.SendMembers(AxModel=startAxModel, b=boolean, axm=byProperties)

# group: Add supports at boundary
ptListIndexAtHeight = DyToAxisVM.Extra.PtListIndexAtHeight(pts=sendMembers.Points)
pinnedNodalSupport = DyToAxisVM.Support.PinnedNodalSupport(AxModel=sendMembers.AxModel, ptID=ptListIndexAtHeight)

# group: Add load to the rest of the nodes
number = DoubleInput(1)
count = List.Count(list=sendMembers.Points)
sequence_3 = Sequence(start=number, amount=count)
setDifference = List.SetDifference(list1=sequence_3, list2=ptListIndexAtHeight)
number_2 = DoubleInput(-10)
pointLoad = DyToAxisVM.Load.PointLoad(AxModel=pinnedNodalSupport.AxModel, ptID=setDifference, Fz=number_2)
