# Dynamo graph Shukov Tower.dyn "Tower v2" (Dynamo 2.0.1.5055)

startAxModel = DyToAxisVM.AxModel.StartAxModel()

# group: Parameters
radius_level_0 = DoubleSlider(13, range=5..16 step 1)
number_of_bays_1 = IntegerSlider(15, range=0..50 step 1)
height_1 = DoubleSlider(40, range=5..50 step 5)
radius_level_1 = DoubleSlider(10, range=5..16 step 1)
rotation_1 = DoubleSlider(2, range=0..10 step 1)
number_of_bays_2 = IntegerSlider(15, range=0..50 step 1)
height_2 = DoubleSlider(30, range=5..50 step 5)
radius_level_2 = DoubleSlider(7, range=5..16 step 1)
rotation_2 = DoubleSlider(2, range=0..10 step 1)
number_of_bays_3 = IntegerSlider(15, range=0..50 step 1)
height_3 = DoubleSlider(20, range=5..50 step 5)
radius_level_3 = DoubleSlider(5, range=5..16 step 1)
rotation_3 = DoubleSlider(2, range=0..10 step 1)

# group: Geometry
byCenterPointRadius = Circle.ByCenterPointRadius(radius=radius_level_0)
number = DoubleInput(1)
code_block = CodeBlock(x=number_of_bays_1) { 1/(x+1); }
range = Range(end=number, step=code_block)
pointAtParameter = Curve.PointAtParameter(curve=byCenterPointRadius, param=range)
origin = Point.Origin()
ZAxis = Vector.ZAxis()
translate = Geometry.Translate(geometry=origin, direction=ZAxis, distance=height_1)
byCenterPointRadius_2 = Circle.ByCenterPointRadius(centerPoint=translate, radius=radius_level_1)
pointAtParameter_2 = Curve.PointAtParameter(curve=byCenterPointRadius_2, param=range)
number_2 = DoubleInput(1)
code_block_2 = CodeBlock(x=number_of_bays_2) { 1/(x+1); }
range_2 = Range(end=number_2, step=code_block_2)
pointAtParameter_3 = Curve.PointAtParameter(curve=byCenterPointRadius_2, param=range_2)
translate_2 = Geometry.Translate(geometry=translate, direction=ZAxis, distance=height_2)
byCenterPointRadius_3 = Circle.ByCenterPointRadius(centerPoint=translate_2, radius=radius_level_2)
pointAtParameter_4 = Curve.PointAtParameter(curve=byCenterPointRadius_3, param=range_2)
number_3 = DoubleInput(1)
code_block_3 = CodeBlock(x=number_of_bays_3) { 1/(x+1); }
range_3 = Range(end=number_3, step=code_block_3)
pointAtParameter_5 = Curve.PointAtParameter(curve=byCenterPointRadius_3, param=range_3)
translate_3 = Geometry.Translate(geometry=translate_2, direction=ZAxis, distance=height_3)
byCenterPointRadius_4 = Circle.ByCenterPointRadius(centerPoint=translate_3, radius=radius_level_3)
pointAtParameter_6 = Curve.PointAtParameter(curve=byCenterPointRadius_4, param=range_3)
code_block_4 = CodeBlock(h1=height_1, h2=height_2, h3=height_3) { h1+h2+h3; }

# group: Geometry
code_block_5 = CodeBlock(x=rotation_1, nb=number_of_bays_1) { x+1..nb; 0..x; }
join = List.Join(list0=code_block_5.out0, list1=code_block_5.out1)
reorder = List.Reorder(list=pointAtParameter_2, indices=join)
byStartPointEndPoint = Line.ByStartPointEndPoint(startPoint=pointAtParameter, endPoint=reorder)
code_block_6 = CodeBlock(nb=number_of_bays_1, x=rotation_1) { (nb-x)..nb; 0..(nb-x-1); }
join_2 = List.Join(list0=code_block_6.out0, list1=code_block_6.out1)
reorder_2 = List.Reorder(list=pointAtParameter_2, indices=join_2)
byStartPointEndPoint_2 = Line.ByStartPointEndPoint(startPoint=pointAtParameter, endPoint=reorder_2)
intersect = Geometry.Intersect(geometry=byStartPointEndPoint, other=byStartPointEndPoint_2, lacing=CrossProduct)
flatten = List.Flatten(list=intersect)
Z = Point.Z(point=flatten)
number_4 = DoubleInput(2)
round = Math.Round(number=Z, digits=number_4)
groupByKey = List.GroupByKey(list=flatten, keys=round)
boolean = BoolSelector(true)
byPoints = PolyCurve.ByPoints(points=groupByKey.groups, connectLastToFirst=boolean)
curves = PolyCurve.Curves(polyCurve=byPoints)
startPoint = Curve.StartPoint(curve=curves)
endPoint = Curve.EndPoint(curve=curves)
byStartPointEndPoint_3 = Line.ByStartPointEndPoint(startPoint=startPoint, endPoint=endPoint)
intersect_2 = Geometry.Intersect(geometry=byStartPointEndPoint_2, other=byStartPointEndPoint, lacing=CrossProduct)
join_3 = List.Join(list0=intersect, list1=intersect_2)
boolean_2 = BoolSelector(false)
clean = List.Clean(list=join_3, preserveIndices=boolean_2)
flatten_2 = List.Flatten(list=clean, lacing=Shortest)
Z_2 = Point.Z(point=flatten_2)
sortIndexByValue = List.SortIndexByValue(list=Z_2)
getItemAtIndex = List.GetItemAtIndex(list=flatten_2, index=sortIndexByValue, lacing=Shortest)
byPoints_2 = PolyCurve.ByPoints(points=getItemAtIndex)
curves_2 = PolyCurve.Curves(polyCurve=byPoints_2)
startPoint_2 = Curve.StartPoint(curve=curves_2)
endPoint_2 = Curve.EndPoint(curve=curves_2)
byStartPointEndPoint_4 = Line.ByStartPointEndPoint(startPoint=startPoint_2, endPoint=endPoint_2)

flatten_3 = List.Flatten(list=byStartPointEndPoint_3)
flatten_4 = List.Flatten(list=byStartPointEndPoint_4)

# group: Geometry
code_block_7 = CodeBlock(x=rotation_2, nb=number_of_bays_2) { x+1..nb; 0..x; }
join_4 = List.Join(list0=code_block_7.out0, list1=code_block_7.out1)
reorder_3 = List.Reorder(list=pointAtParameter_4, indices=join_4)
byStartPointEndPoint_5 = Line.ByStartPointEndPoint(startPoint=pointAtParameter_3, endPoint=reorder_3)
code_block_8 = CodeBlock(nb=number_of_bays_2, x=rotation_2) { (nb-x)..nb; 0..(nb-x-1); }
join_5 = List.Join(list0=code_block_8.out0, list1=code_block_8.out1)
reorder_4 = List.Reorder(list=pointAtParameter_4, indices=join_5)
byStartPointEndPoint_6 = Line.ByStartPointEndPoint(startPoint=pointAtParameter_3, endPoint=reorder_4)
intersect_3 = Geometry.Intersect(geometry=byStartPointEndPoint_5, other=byStartPointEndPoint_6, lacing=CrossProduct)
flatten_5 = List.Flatten(list=intersect_3)
Z_3 = Point.Z(point=flatten_5)
number_5 = DoubleInput(2)
round_2 = Math.Round(number=Z_3, digits=number_5)
groupByKey_2 = List.GroupByKey(list=flatten_5, keys=round_2)
boolean_3 = BoolSelector(true)
byPoints_3 = PolyCurve.ByPoints(points=groupByKey_2.groups, connectLastToFirst=boolean_3)
intersect_4 = Geometry.Intersect(geometry=byStartPointEndPoint_6, other=byStartPointEndPoint_5, lacing=CrossProduct)
join_6 = List.Join(list0=intersect_3, list1=intersect_4)
boolean_4 = BoolSelector(false)
clean_2 = List.Clean(list=join_6, preserveIndices=boolean_4)
flatten_6 = List.Flatten(list=clean_2, lacing=Shortest)
Z_4 = Point.Z(point=flatten_6)
sortIndexByValue_2 = List.SortIndexByValue(list=Z_4)
getItemAtIndex_2 = List.GetItemAtIndex(list=flatten_6, index=sortIndexByValue_2, lacing=Shortest)
byPoints_4 = PolyCurve.ByPoints(points=getItemAtIndex_2)
curves_3 = PolyCurve.Curves(polyCurve=byPoints_4)
startPoint_3 = Curve.StartPoint(curve=curves_3)
endPoint_3 = Curve.EndPoint(curve=curves_3)
byStartPointEndPoint_7 = Line.ByStartPointEndPoint(startPoint=startPoint_3, endPoint=endPoint_3)

restOfItems = List.RestOfItems(list=byPoints_3)

# group (continued): Geometry
curves_4 = PolyCurve.Curves(polyCurve=restOfItems)
startPoint_4 = Curve.StartPoint(curve=curves_4)
endPoint_4 = Curve.EndPoint(curve=curves_4)
byStartPointEndPoint_8 = Line.ByStartPointEndPoint(startPoint=startPoint_4, endPoint=endPoint_4)

flatten_7 = List.Flatten(list=byStartPointEndPoint_8)
flatten_8 = List.Flatten(list=byStartPointEndPoint_7)

# group: Geometry
code_block_9 = CodeBlock(x=rotation_3, nb=number_of_bays_3) { x+1..nb; 0..x; }
join_7 = List.Join(list0=code_block_9.out0, list1=code_block_9.out1)
reorder_5 = List.Reorder(list=pointAtParameter_6, indices=join_7)
byStartPointEndPoint_9 = Line.ByStartPointEndPoint(startPoint=pointAtParameter_5, endPoint=reorder_5)
code_block_10 = CodeBlock(nb=number_of_bays_3, x=rotation_3) { (nb-x)..nb; 0..(nb-x-1); }
join_8 = List.Join(list0=code_block_10.out0, list1=code_block_10.out1)
reorder_6 = List.Reorder(list=pointAtParameter_6, indices=join_8)
byStartPointEndPoint_10 = Line.ByStartPointEndPoint(startPoint=pointAtParameter_5, endPoint=reorder_6)
intersect_5 = Geometry.Intersect(geometry=byStartPointEndPoint_9, other=byStartPointEndPoint_10, lacing=CrossProduct)
flatten_9 = List.Flatten(list=intersect_5)
Z_5 = Point.Z(point=flatten_9)
number_6 = DoubleInput(2)
round_3 = Math.Round(number=Z_5, digits=number_6)
groupByKey_3 = List.GroupByKey(list=flatten_9, keys=round_3)
boolean_5 = BoolSelector(true)
byPoints_5 = PolyCurve.ByPoints(points=groupByKey_3.groups, connectLastToFirst=boolean_5)
intersect_6 = Geometry.Intersect(geometry=byStartPointEndPoint_10, other=byStartPointEndPoint_9, lacing=CrossProduct)
join_9 = List.Join(list0=intersect_5, list1=intersect_6)
boolean_6 = BoolSelector(false)
clean_3 = List.Clean(list=join_9, preserveIndices=boolean_6)
flatten_10 = List.Flatten(list=clean_3, lacing=Shortest)
Z_6 = Point.Z(point=flatten_10)
sortIndexByValue_3 = List.SortIndexByValue(list=Z_6)
getItemAtIndex_3 = List.GetItemAtIndex(list=flatten_10, index=sortIndexByValue_3, lacing=Shortest)
byPoints_6 = PolyCurve.ByPoints(points=getItemAtIndex_3)
curves_5 = PolyCurve.Curves(polyCurve=byPoints_6)
startPoint_5 = Curve.StartPoint(curve=curves_5)
endPoint_5 = Curve.EndPoint(curve=curves_5)
byStartPointEndPoint_11 = Line.ByStartPointEndPoint(startPoint=startPoint_5, endPoint=endPoint_5)

restOfItems_2 = List.RestOfItems(list=byPoints_5)

# group (continued): Geometry
curves_6 = PolyCurve.Curves(polyCurve=restOfItems_2)
startPoint_6 = Curve.StartPoint(curve=curves_6)
endPoint_6 = Curve.EndPoint(curve=curves_6)
byStartPointEndPoint_12 = Line.ByStartPointEndPoint(startPoint=startPoint_6, endPoint=endPoint_6)

flatten_11 = List.Flatten(list=byStartPointEndPoint_12)
flatten_12 = List.Flatten(list=byStartPointEndPoint_11)

# group: AxMembers
string = StringInput("ROR  133,00*   7,1")
byProperties = DyToAxisVM.AxMember.ByProperties(line=flatten_3, crossSection=string)
string_2 = StringInput("ROR  273,00*  10,0")
byProperties_2 = DyToAxisVM.AxMember.ByProperties(line=flatten_4, crossSection=string_2)
string_3 = StringInput("ROR  133,00*   7,1")
byProperties_3 = DyToAxisVM.AxMember.ByProperties(line=flatten_7, crossSection=string_3)
string_4 = StringInput("ROR  273,00*  10,0")
byProperties_4 = DyToAxisVM.AxMember.ByProperties(line=flatten_8, crossSection=string_4)
string_5 = StringInput("ROR  133,00*   7,1")
byProperties_5 = DyToAxisVM.AxMember.ByProperties(line=flatten_11, crossSection=string_5)
string_6 = StringInput("ROR  273,00*  10,0")
byProperties_6 = DyToAxisVM.AxMember.ByProperties(line=flatten_12, crossSection=string_6)

join_10 = List.Join(list0=byProperties, list1=byProperties_2, list2=byProperties_3, list3=byProperties_4, list4=byProperties_5, list5=byProperties_6)
flatten_13 = List.Flatten(list=join_10)

# group: Export members
boolean_7 = BoolSelector(false)
sendMembers = DyToAxisVM.ExportOptions.SendMembers(AxModel=startAxModel, b=boolean_7, axm=flatten_13)

# group: Add load
ptListIndexAtHeight = DyToAxisVM.Extra.PtListIndexAtHeight(pts=sendMembers.Points, Z=code_block_4)
string_7 = StringInput("ST1")
number_7 = DoubleInput(-5)
pointLoad = DyToAxisVM.Load.PointLoad(AxModel=sendMembers.AxModel, ptID=ptListIndexAtHeight, lcName=string_7, Fz=number_7)
selfWeight = DyToAxisVM.Load.SelfWeight(AxModel=sendMembers.AxModel)

# group: Analysis
boolean_8 = BoolSelector(false)
linearAnalysis = DyToAxisVM.Analysis.LinearAnalysis(AxModel=pointLoad.AxModel, b=boolean_8)

# group: Add supports
number_8 = DoubleInput(0)
ptListIndexAtHeight_2 = DyToAxisVM.Extra.PtListIndexAtHeight(pts=sendMembers.Points, Z=number_8)
fixedNodalSupport = DyToAxisVM.Support.FixedNodalSupport(AxModel=sendMembers.AxModel, ptID=ptListIndexAtHeight_2)
