# Dynamo graph TrussTemplate.dyn (Dynamo 2.0.1.5055)

# group: Create new AxisVM model
startAxModel = DyToAxisVM.AxModel.StartAxModel()

# group: Parameters
span_x = DoubleSlider(16.7, range=0..30 step 0.1)
number_chords = IntegerSlider(5, range=0..100 step 1)
height_at_ends_m = DoubleSlider(2, range=0..10 step 0.1)
height_at_peak_m = DoubleSlider(3, range=0..10 step 0.1)

# group: Create geometry
code_block = CodeBlock(x=span_x, y=number_chords) { x/(2*y)/2; x/(2*y); 2*y; 2*y+1; }
sequence = Sequence(amount=code_block.out3, step=code_block.out1)
takeItems = List.TakeItems(list=sequence, amount=number_chords)
code_block_2 = CodeBlock(h1=height_at_ends_m, h2=height_at_peak_m, x=takeItems, L=span_x) { h1+(h2-h1)*x/L*2; }
dropItems = List.DropItems(list=sequence, amount=number_chords)
code_block_3 = CodeBlock(h1=height_at_ends_m, h2=height_at_peak_m, L=span_x, x=dropItems) { h1+(h2-h1)*(L-x)/L*2; }
join = List.Join(list0=code_block_2, list1=code_block_3)
byCoordinates = Point.ByCoordinates(x=sequence, z=join)
restOfItems = List.RestOfItems(list=byCoordinates)
byStartPointEndPoint = Line.ByStartPointEndPoint(startPoint=byCoordinates, endPoint=restOfItems)
code_block_4 = CodeBlock(x=span_x) { 0; x; }
sequence_2 = Sequence(start=code_block.out0, amount=code_block.out2, step=code_block.out1)
addItemToFront = List.AddItemToFront(item=code_block_4.out0, list=sequence_2)
addItemToEnd = List.AddItemToEnd(item=code_block_4.x, list=addItemToFront)
byCoordinates_2 = Point.ByCoordinates(x=addItemToEnd)
restOfItems_2 = List.RestOfItems(list=byCoordinates_2)
byStartPointEndPoint_2 = Line.ByStartPointEndPoint(startPoint=byCoordinates_2, endPoint=restOfItems_2)
byStartPointEndPoint_3 = Line.ByStartPointEndPoint(startPoint=byCoordinates_2, endPoint=byCoordinates)
byStartPointEndPoint_4 = Line.ByStartPointEndPoint(startPoint=restOfItems_2, endPoint=byCoordinates)

# group: Split trusses into two
join_2 = List.Join(list0=byStartPointEndPoint_3, list1=byStartPointEndPoint_4)
length = Curve.Length(curve=join_2)
sortByKey = List.SortByKey(list=join_2, keys=length)
integer_slider = IntegerSlider(7, range=0..10 step 1)
code_block_5 = CodeBlock(x=integer_slider) { x*2; }
takeItems_2 = List.TakeItems(list=sortByKey.sorted_list, amount=code_block_5)
dropItems_2 = List.DropItems(list=sortByKey.sorted_list, amount=code_block_5)

# group: Curves to Lines
upper_chord = List.Create(item0=byStartPointEndPoint)
startPoint = Curve.StartPoint(curve=upper_chord)
endPoint = Curve.EndPoint(curve=upper_chord)
byStartPointEndPoint_5 = Line.ByStartPointEndPoint(startPoint=startPoint, endPoint=endPoint)
lower_chord = List.Create(item0=byStartPointEndPoint_2)
startPoint_2 = Curve.StartPoint(curve=lower_chord)
endPoint_2 = Curve.EndPoint(curve=lower_chord)
byStartPointEndPoint_6 = Line.ByStartPointEndPoint(startPoint=startPoint_2, endPoint=endPoint_2)
trusses_1 = List.Create(item0=takeItems_2)
startPoint_3 = Curve.StartPoint(curve=trusses_1)
endPoint_3 = Curve.EndPoint(curve=trusses_1)
byStartPointEndPoint_7 = Line.ByStartPointEndPoint(startPoint=startPoint_3, endPoint=endPoint_3)
trusses_2 = List.Create(item0=dropItems_2)
startPoint_4 = Curve.StartPoint(curve=trusses_2)
endPoint_4 = Curve.EndPoint(curve=trusses_2)
byStartPointEndPoint_8 = Line.ByStartPointEndPoint(startPoint=startPoint_4, endPoint=endPoint_4)

# group: Create AxMembers with various cross-section sizes
string = StringInput("S 235")
string_2 = StringInput("HE  160 A")
string_3 = StringInput("beam")
byProperties = DyToAxisVM.AxMember.ByProperties(line=byStartPointEndPoint_5, material=string, crossSection=string_2, type=string_3)
string_4 = StringInput("HE  120 A")
byProperties_2 = DyToAxisVM.AxMember.ByProperties(line=byStartPointEndPoint_6, material=string, crossSection=string_4, type=string_3)
string_5 = StringInput(" 60X 40X 3,2")
byProperties_3 = DyToAxisVM.AxMember.ByProperties(line=byStartPointEndPoint_7, material=string, crossSection=string_5, type=string_3)
string_6 = StringInput(" 80X 40X 3,2")
byProperties_4 = DyToAxisVM.AxMember.ByProperties(line=byStartPointEndPoint_8, material=string, crossSection=string_6, type=string_3)

join_3 = List.Join(list0=byProperties, list1=byProperties_2, list2=byProperties_3, list3=byProperties_4)
flatten = List.Flatten(list=join_3)

# group: Send AxMembers to Axis
boolean = BoolSelector(false)
sendMembers = DyToAxisVM.ExportOptions.SendMembers(AxModel=startAxModel, b=boolean, axm=flatten)
